% Simulink data dictionary DataDictionary.sldd

InputDataInterface = Simulink.Bus()
  DataA: double
  DataB: double

OutputDataInterface = Simulink.Bus()
  DataC: double

ClientServiceInterface = Simulink.ServiceBus()
  add: DataD = add(DataA,DataB), Asynchronous=false, Arguments=[Simulink.BusElement(Name="DataA", DataType="double"), Simulink.BusElement(Name="DataB", DataType="double"), Simulink.BusElement(Name="DataD", DataType="double")]

ServerServiceInterface = Simulink.ServiceBus()
  getDataC: DataC = getDataC(), Asynchronous=false, Arguments=Simulink.BusElement(Name="DataC", DataType="double")
  setDataB: setDataB(DataB), Asynchronous=false, Arguments=Simulink.BusElement(Name="DataB", DataType="double")
  callAdd: DataD = callAdd(DataA,DataB), Asynchronous=false, Arguments=[Simulink.BusElement(Name="DataA", DataType="double"), Simulink.BusElement(Name="DataB", DataType="double"), Simulink.BusElement(Name="DataD", DataType="double")]
  setDataA: setDataA(DataA), Asynchronous=false, Arguments=Simulink.BusElement(Name="DataA", DataType="double")