% Simulink data dictionary Wrapper_oClientServer_Model.sldd
% references DataDictionary.sldd

s_CC278 = Simulink.Signal(StorageClass="ExportedGlobal", Alias="ClientService_add_DataA_In", DataType="double")
s_D6868 = Simulink.Signal(StorageClass="ExportedGlobal", Alias="ClientService_add_DataB_In", DataType="double")
s_DAA18 = Simulink.Signal(StorageClass="ExportedGlobal", Alias="ClientService_add_DataD_Out", DataType="double")
c_47DC4 = Simulink.Signal(StorageClass="ExportedGlobal", Alias="ServerService_getDataC_DataC_Out", DataType="double")
c_D691D = Simulink.Signal(StorageClass="ExportedGlobal", Alias="ServerService_setDataB_DataB_In", DataType="double")
c_01EAF = Simulink.Signal(StorageClass="ExportedGlobal", Alias="ServerService_setDataA_DataA_In", DataType="double")